# Dynamo graph ThreeSolidTower_04_SolarAnalysis.dyn (Dynamo 2.1.0.7500)

# group: INTEGRATE: Select site volume from Revit
# note: Select a Revit mass representing the volumetric constraints of a site (heights, setbacks, etc)
select_model_element = DSModelElementSelection()  # 1 picked in the model

# group: INPUTS: u, v for variable corner point
u1 = DoubleSlider(0.9, range=0..1 step 0.1)  # graph input
v1 = DoubleSlider(0.1, range=0..1 step 0.1)  # graph input

# group: INPUTS: splitting parameters
param_1 = DoubleSlider(0.6, range=0..1 step 0.1)  # graph input
param_2 = DoubleSlider(0.5, range=0..1 step 0.1)  # graph input
param_3 = DoubleSlider(0.6, range=0..1 step 0.1)  # graph input
list_create = List.Create(item0=param_1, item1=param_2, item2=param_3)

# group: INPUTS: volume heights
height_01 = DoubleSlider(54.6, range=5..200 step 0.1)
height_02 = DoubleSlider(183.9, range=5..200 step 0.1)
height_03 = DoubleSlider(118.6, range=5..200 step 0.1)
list_create_2 = List.Create(item0=height_01, item1=height_02, item2=height_03)

# group: GENERATOR: create floors
floorHeight = DoubleInput(15)
code_block = CodeBlock(height=list_create_2, FloorHeight=floorHeight) { 0..height..FloorHeight; }
code_block_2 = CodeBlock { -1; }
dropItems = List.DropItems(list=code_block@L2, amount=code_block_2)
byCoordinates = Point.ByCoordinates(z=dropItems)
byOriginNormal = Plane.ByOriginNormal(origin=byCoordinates)
count = List.Count(list=byOriginNormal@L2)
sortByKey = List.SortByKey(list=byOriginNormal, keys=count)
lastItem = List.LastItem(list=sortByKey.sorted_list)

floor_1_window_offset_size = DoubleSlider(5, range=0.5..5 step 0.01)  # graph input

# group: Set the location
code_block_3 = CodeBlock { 41.1579; -8.6291; }
byLatitudeLongitude = DynamoSolarAnalysis.Weather.Weather.ByLatitudeLongitude(latitude=code_block_3.out0, longitude=code_block_3.out1)

# group: INTEGRATE: Select urban context from Revit
# note: Select a Revit mass representing the urban context.
select_model_element_2 = DSModelElementSelection()  # 1 picked in the model

# group: Create time study
date_time = DateTime("2019-09-10T16:01:00Z")
still = DynamoSolarAnalysis.Analysis.TimeStudy.Still(dateTime=date_time)

number_slider = DoubleSlider(10, range=0..100 step 0.1)

# group: INTEGRATE: Select park area
select_model_element_3 = DSModelElementSelection()  # 1 picked in the model

# group: INTEGRATE: Convert to Dynamo objects
solids = Element.Solids(element=select_model_element)
remember = Data.Remember(solids)
byUnion = Solid.ByUnion(solids=remember)
solids_2 = Element.Solids(element=select_model_element_2)
remember_2 = Data.Remember(solids_2)
faces = Element.Faces(element=select_model_element_3)
code_block_4 = CodeBlock(a=faces) { a[1]; }
remember_3 = Data.Remember(code_block_4)
perimeterCurves = Surface.PerimeterCurves(surface=remember_3)

# group: Extract site outline
bySolid = PolySurface.BySolid(solid=byUnion)
surfaces = PolySurface.Surfaces(polySurface=bySolid)
number = DoubleInput(0.5)
pointAtParameter = Surface.PointAtParameter(surface=surfaces, u=number, v=number)
Z = Point.Z(point=pointAtParameter)
sortByKey_2 = List.SortByKey(list=surfaces, keys=Z)
number_2 = DoubleInput(0)
getItemAtIndex = List.GetItemAtIndex(list=sortByKey_2.sorted_list, index=number_2)

perimeterCurves_2 = Surface.PerimeterCurves(surface=getItemAtIndex)

# group: GENERATOR: Create mass outline
endPoint = Curve.EndPoint(curve=perimeterCurves_2)
code_block_5 = CodeBlock { 2; }
code_block_6 = CodeBlock { 0.5; }
divideSurface = Autodesk.RefineryToolkits.SpacePlanning.Generate.SurfaceDivision2D.DivideSurface(surface=getItemAtIndex, U=code_block_6, V=code_block_6)
code_block_7 = CodeBlock(a=divideSurface) { a[0]; }
pointAtParameter_2 = Surface.PointAtParameter(surface=code_block_7, u=u1, v=v1)
replaceItemAtIndex = List.ReplaceItemAtIndex(list=endPoint, index=code_block_5, item=pointAtParameter_2)
byPoints = Polygon.ByPoints(points=replaceItemAtIndex)
reverse = Curve.Reverse(curve=byPoints)

# group: GENERATOR: Split base surface in three parts
code_block_8 = CodeBlock(massPolygon=reverse, sitePerimeterCurves=perimeterCurves_2, splittngParameters=list_create) { massPolygon; sitePerimeterCurves; splittngParameters; }
byPatch = Surface.ByPatch(closedCurve=code_block_8.massPolygon)
center = Polygon.Center(polygon=code_block_8.massPolygon)
code_block_9 = CodeBlock { 3; }
removeItemAtIndex = List.RemoveItemAtIndex(list=code_block_8.sitePerimeterCurves, indices=code_block_9)
pointAtParameter_3 = Curve.PointAtParameter(curve=removeItemAtIndex, param=code_block_8.splittngParameters)
byStartPointEndPoint = Line.ByStartPointEndPoint(startPoint=center, endPoint=pointAtParameter_3)
geometry_splitbytools = Custom[[&] Geometry.SplitByTools](geometry=byPatch, tools=byStartPointEndPoint)  # Split one piece of geometry (other than a polysurface) by multiple tools

# group: GENERATOR: create building volume
lastItem_2 = List.LastItem(list=code_block@L2)
code_block_10 = CodeBlock { false; }
thicken = Surface.Thicken(surface=geometry_splitbytools, thickness=lastItem_2, both_sides=code_block_10)
byUnion_2 = Solid.ByUnion(solids=thicken)

# group (continued): GENERATOR: create floors
intersect = Geometry.Intersect(geometry=byUnion_2, other=lastItem, lacing=Longest)
flatten = List.Flatten(list=intersect)

# group: Testing the direction of all floors
code_block_11 = CodeBlock(horizontal=flatten) { horizontal; }
code_block_12 = CodeBlock { 0.5; }
normalAtParameter = Surface.NormalAtParameter(surface=code_block_11, u=code_block_12, v=code_block_12)
Z_2 = Vector.Z(vector=normalAtParameter)
code_block_13 = CodeBlock { -1; }
eq = Z_2 == code_block_13
code_block_14 = CodeBlock { 0.5; }
pointAtParameter_4 = Surface.PointAtParameter(surface=code_block_11, u=code_block_14, v=code_block_14)
byOriginNormal_2 = Plane.ByOriginNormal(origin=pointAtParameter_4, normal=normalAtParameter)
mirror = Geometry.Mirror(geometry=code_block_11, mirrorPlane=byOriginNormal_2)
if_ = If(test=eq, true=mirror, false=code_block_11)

# group: GENERATOR: create floor slice
code_block_15 = CodeBlock { false; }
thicken_2 = Surface.Thicken(surface=if_, thickness=floorHeight, both_sides=code_block_15)
deconstructFacadeShell = Autodesk.RefineryToolkits.MassingSandbox.Generate.Building.DeconstructFacadeShell(solid=thicken_2)

# group: GENERATOR: Create openings on facade
code_block_16 = CodeBlock(surface=deconstructFacadeShell.verticalSrfList, windowOffset=floor_1_window_offset_size) { surface; windowOffset; }
perimeterCurves_3 = Surface.PerimeterCurves(surface=code_block_16.surface)
byJoinedCurves = PolyCurve.ByJoinedCurves(curves=perimeterCurves_3@@L2)
code_block_17 = CodeBlock { -1; }
mul = code_block_16.windowOffset * code_block_17
offset = Curve.Offset(curve=byJoinedCurves, distance=mul)
byPatch_2 = Surface.ByPatch(closedCurve=offset)
code_block_18 = CodeBlock { 2; }
thicken_3 = Surface.Thicken(surface=byPatch_2, thickness=code_block_18)
subtractFrom = Surface.SubtractFrom(surface=code_block_16.surface, trimmingEntity=thicken_3)
flatten_2 = List.Flatten(list=subtractFrom)

# group: EVALUATOR: compute window to wall ratio
flatten_3 = List.Flatten(list=byPatch_2)
area = Surface.Area(surface=flatten_3)
sum = Math.Sum(values=area)
area_2 = Surface.Area(surface=deconstructFacadeShell.verticalSrfList)
flatten_4 = List.Flatten(list=area_2)
sum_2 = Math.Sum(values=flatten_4)
div = sum / sum_2
WWR = Watch(div)  # graph output

# group: SOLAR ANALYSIS EVALUATOR: get horizontal surfaces
deconstructFacadeShell_2 = Autodesk.RefineryToolkits.MassingSandbox.Generate.Building.DeconstructFacadeShell(solid=byUnion_2)
lastItem_3 = List.LastItem(list=deconstructFacadeShell_2.horizontalSrfList)
code_block_19 = CodeBlock { -1; }
dropItems_2 = List.DropItems(list=deconstructFacadeShell_2.horizontalSrfList, amount=code_block_19)
code_block_20 = CodeBlock(groundLevel=lastItem_3, topLevels=dropItems_2) { groundLevel; topLevels; }

# group: Urban context
code_block_21 = CodeBlock(urbanContextSolids=remember_2) { urbanContextSolids; }
explode = Geometry.Explode(geometry=code_block_21)
flatten_5 = List.Flatten(list=explode)

# group: ALL shading objects
list_create_3 = List.Create(item0=code_block_20.topLevels, item1=flatten_5, item2=flatten_2, item3=if_)
flatten_6 = List.Flatten(list=list_create_3)

# group: Solar analysis for floors
code_block_22 = CodeBlock(floors=if_) { floors; }
code_block_23 = CodeBlock { yellow=Color.ByARGB(255,255,255,0); black=Color.ByARGB(0,0,0,0); colors = [black, yellow]; indices=[0,1]; }
analyze = DynamoSolarAnalysis.Analysis.SolarAnalysis.Analyze(weather=byLatitudeLongitude, analysisSurfaces=code_block_22, shadingSurfaces=flatten_6, timeStudy=still, spacing=number_slider)
flatten_7 = List.Flatten(list=analyze.Cumulative)
maximumItem = List.MaximumItem(list=flatten_7)
code_block_24 = CodeBlock(n=analyze.Cumulative, max=maximumItem) { n/max; }
color_range = ColorRange(colors=code_block_23.colors, indices=code_block_23.indices, value=code_block_24)
bySurfaceColors = Modifiers.GeometryColor.BySurfaceColors(surface=code_block_22, colors=color_range)

# group: OUTPUT - EXPOSURE ON FLOORS
average = Math.Average(numbers=flatten_7)
average_exposure_on_floors = Watch(average)  # graph output

# group: Solar analysis for roofs
code_block_25 = CodeBlock(roofTops=code_block_20.topLevels) { roofTops; }
code_block_26 = CodeBlock { yellow=Color.ByARGB(255,255,255,0); black=Color.ByARGB(0,0,0,0); colors = [black, yellow]; indices=[0,1]; }
analyze_2 = DynamoSolarAnalysis.Analysis.SolarAnalysis.Analyze(weather=byLatitudeLongitude, analysisSurfaces=code_block_25, shadingSurfaces=flatten_5, timeStudy=still, spacing=number_slider)
flatten_8 = List.Flatten(list=analyze_2.Cumulative)
maximumItem_2 = List.MaximumItem(list=flatten_8)
code_block_27 = CodeBlock(n=analyze_2.Cumulative, max=maximumItem_2) { n/max; }
color_range_2 = ColorRange(colors=code_block_26.colors, indices=code_block_26.indices, value=code_block_27)
bySurfaceColors_2 = Modifiers.GeometryColor.BySurfaceColors(surface=code_block_25, colors=color_range_2)

# group: OUTPUT - EXPOSURE ON ROOFS
average_2 = Math.Average(numbers=flatten_8)
average_exposure_on_roof = Watch(average_2)  # graph output

# group: DISPLAY: color site context
color_palette = ColorPalette({R: 211, G: 211, B: 211, A: 107})
byGeometryColor = Modifiers.GeometryColor.ByGeometryColor(geometry=remember_2, color=color_palette)

# group: DISPLAY: color zoning boundary
bySolid_2 = PolySurface.BySolid(solid=byUnion)
surfaces_2 = PolySurface.Surfaces(polySurface=bySolid_2)
perimeterCurves_4 = Surface.PerimeterCurves(surface=surfaces_2)
color_palette_2 = ColorPalette({R: 255, G: 20, B: 147, A: 255})
byGeometryColor_2 = Modifiers.GeometryColor.ByGeometryColor(geometry=perimeterCurves_4, color=color_palette_2)
